# Grasshopper definition dev_big.ghx (Grasshopper 1.0.7)

# ---- group: Add Module Path
python = GhPythonScript(PATH="C:\Users\yoshioca\Documents\GH_Gcode")  # -> out, a
# ---------- python: Python ----------
import sys

sys.path.append(PATH)

print(sys.path)
# ---------- end python ----------

# ----
panel = Panel(python.out)

# ---- group: Input Polyline
# Dev
# - Polyline to GCode -
crv = Curve([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])

# ---- group: S = 0.04 * F
panel_2 = Panel("0.04")

# ---- group: M4
panel_3 = Panel("50")

# ---- group: F
panel_4 = Panel("1800")

# ---- group: Export
button = Button()

# ---- group: Export Path
panel_5 = Panel("C:\Users\yoshioca\Documents\GH_Gcode\_data_\data_out\")

# ----
# - Viewer -
panel_6 = Panel("C:\Users\yoshioca\Documents\GH_Gcode\_data_\data_out\2020-04-27_07-02-45.txt")
python_2 = GhPythonScript(AMP=panel_2, F=panel_4)  # -> M3
# ---------- python_2: Python ----------
M3 = int(float(F) * float(AMP))
# ---------- end python_2 ----------
panel_7 = Panel(python_2)
preview = CustomPreview(
    Geometry=crv,
    Material={diffuse=RGB(221, 160, 221), emission=RGB(66, 48, 66), shine=0.5, specular=RGB(255, 255, 255), transparency=0})
python_3 = GhPythonScript(PATH=panel_6)  # -> out, MOVE
# ---------- python_3: Python ----------
import rhinoscriptsyntax as rs


##################################
###    module for Grasshopper    #
###    Python 2                  #
##################################


class Gcode_for_GH():
    
    
    def open_file(self, path):
        with open(path) as f:
            l = f.readlines()
        # print(type(l))
        # print(len(l))
        # print(l)
        return l
    

    def add_xyz_to_polyline(self, path):

        gcode = self.open_file(path)

        count = 0
        x = []
        y = []
        z = []

        ### init
        x.append(0)
        y.append(0)
        z.append(0)

        # loop = 20
        loop = len(gcode)

        for i in range(loop):

            count += 1
            str_ = gcode[i]
            
            if ("X" in str_):
                ### Split Elements
                elements = str_.split()
                for j in range(len(elements)):
                    e = elements[j]
                    
                    if ("X" in e):
                        tmp_x = e.split("X")
                        x.append(tmp_x[1])
            else:
                tmp_x = x[i]
                x.append(tmp_x)


        for ii in range(loop):

            str_ = gcode[ii]
            
            if ("Y" in str_):
                ### Split Elements
                elements = str_.split()
                for jj in range(len(elements)):
                    e = elements[jj]
                    
                    if ("Y" in e):
                        tmp_y = e.split("Y")
                        y.append(tmp_y[1])
            else:
                tmp_y = y[ii]
                y.append(tmp_y)


        for iii in range(loop):

            str_ = gcode[iii]
            
            if ("Z" in str_):
                ### Split Elements
                elements = str_.split()
                for jjj in range(len(elements)):
                    e = elements[jjj]
                    
                    if ("Z" in e):
                        tmp_z = e.split("Z")
                        z.append(tmp_z[1])
            else:
                tmp_z = z[iii]
                z.append(tmp_z)

        # print("x : {} / {}".format(len(x), x))
        # print("y : {} / {}".format(len(y), y))
        # print("z : {} / {}".format(len(z), z))

        print("Count : {}".format(count))
        
        return x, y, z
    
    
    def zip_matrix(self, mat):
        ### https://note.nkmk.me/python-list-transpose/
        return [list(x) for x in zip(*mat)]



###################################


gg = Gcode_for_GH()


v = gg.add_xyz_to_polyline(PATH)
v_f = gg.zip_matrix(v)

print(len(v_f))
#print(v_f)



MOVE = rs.AddPolyline(v_f)
# ---------- end python_3 ----------
python_4 = GhPythonScript(POLYLINES=crv, M3_S_VALUE=panel_7, M4_S_VALUE=panel_3, F_VALUE=panel_4, EXPORT=button, EXPORT_DIR=panel_5)  # -> out, POINTS; inputs POLYLINES: list
# ---------- python_4: Python ----------
import rhinoscriptsyntax as rs

from gh_gcode import operate_curve, operate_big_gcode, util

gc = operate_curve.Curve()
gg = operate_big_gcode.Gcode()
ut = util.Util()

reload(operate_curve)
reload(operate_big_gcode)
reload(util)


##########


### Polylines to Points
pts = gc.polylines_to_points(POLYLINES)
POINTS = ut.flatten_runtime_list(pts)

### Points to Gcode
gcode = gg.points_list_to_gcode(pts, M3_S_VALUE, M4_S_VALUE, F_VALUE)



if EXPORT == True:
    ut.export_gcode(EXPORT_DIR, gcode)
# ---------- end python_4 ----------
panel_8 = Panel(python_4.out)
pt = Point(python_4.POINTS)
panel_9 = Panel("C:\Users\yoshioca\Documents\GH_Gcode\_data_\data_out\")

# ---- group: Draw Sequence
divide = DivideCurve(Curve=python_3.MOVE, Count=1000, Kinks=False)  # -> Points, Tangents, Parameters
item = ListItem(List=divide.Points, Index=Slider(470, range=0..1000), Wrap=True)
sph = Sphere(Base=item, Radius=5)

# ---- group: Build Plate
python_5 = GhPythonScript()  # -> out, AREA
# ---------- python_5: Python ----------
import rhinoscriptsyntax as rs

AREA = rs.AddRectangle(rs.WorldXYPlane(), 1700, 1300)
# ---------- end python_5 ----------
preview_2 = CustomPreview(Geometry=python_5.AREA, Material=ColourSwatch(SwatchColor=RGB(187, 255, 255)))
